# Grasshopper definition 581DL_FinalAssignment_Helia-Andrea2.gh (Grasshopper 1.0.7)
# plug-ins: Firefly.X, Firefly.Core

# ---- group: Part C - Real-time light sensing
ports_available = COMPortsAvailable()
toggle = BooleanToggle(True)
panel = Panel(ports_available)
timer = Timer(TimerInterval=100, Target=read)
read = SerialReadGeneric(StartReadingValues=toggle, PortNumber=ports_available)  # -> SerialOutput, StatusMessage
open_port = OpenClosePort(OpenClosePort=toggle, PortNumber=ports_available, BaudRate="9600")
panel_2 = Panel(open_port)
panel_3 = Panel(read.SerialOutput)
remap = RemapNumbers(Value=panel_3, Source="0 to 1023", Target="0.0 to 1.0")  # -> Mapped, Clipped
panel_4 = Panel(remap.Mapped)
pi = Pi(Factor=panel_4)
# either enable and
# connect C.light-sensing
# or A.city-based groups
# to part D degrees:
python = GhPythonScript(Sunlight_value=pi)  # -> angle
# ---------- python: Python ----------
from math import pi

maxAngle = pi

if Sunlight_value == pi: #too bright then windows should be closed.
    angle = 0

elif Sunlight_value == 0 : #too dark then windows should be open.
    angle = maxAngle/2
else :
    angle = maxAngle/4

print(angle)
# ---------- end python ----------
panel_5 = Panel(pi)

# ---- group: Part A2 - Automatic recognition of current location by IP Address
py_get_ip_address = PythonScript(apiKey="66d3115d67bde16c3c0d4a520190db6d")  # -> out, ip
# ---------- py_get_ip_address: Python ----------
from System.Net import WebClient
import json

url = "https://api.ipify.org?format=json"

file = WebClient().DownloadString(url)

dict = json.loads(file)
#print(dict)

ip = dict["ip"]
print(ip)
# ---------- end py_get_ip_address ----------
auto_recognition = Panel(py_get_ip_address.ip)
py_geolocationbyipaddress = PythonScript(apiKey="66d3115d67bde16c3c0d4a520190db6d", ip=auto_recognition)  # -> out, city
# ---------- py_geolocationbyipaddress: Python ----------
from System.Net import WebClient
import json

url = "http://api.ipstack.com/" + str(ip) + "?access_key=abb2c1a341084d59e06f902d1c0d9065"
#print(url)

file = WebClient().DownloadString(url)
#print file

dict = json.loads(file)

lat = dict["latitude"]
lon = dict["longitude"]
city = dict["city"]

print(dict)
print(lat)
print(lon)
print(city)

#
#213.3.18.83
# ---------- end py_geolocationbyipaddress ----------
panel_6 = Panel(py_geolocationbyipaddress.city)
python_2 = PythonScript(apiKey="66d3115d67bde16c3c0d4a520190db6d", city=panel_6)  # -> out, weather, location
# ---------- python_2: Python ----------
from System.Net import WebClient
import json

url = "https://api.openweathermap.org/data/2.5/weather?q=" + city + "&appid=" + apiKey
#print(url)

file = WebClient().DownloadString(url)
#print file

dict = json.loads(file)

weather = dict["weather"][0]["main"]
location = dict["name"]

print(dict)
# ---------- end python_2 ----------
panel_7 = Panel(python_2.weather)

# ----
manual_input = Panel("151.241.209.249")

# ---- group: Tower Geometrical Definition
cyl = Cylinder(Base=PlaneXY(0, 0, 0), Radius=Slider(2, range=0..10), Length=Slider(10, range=0..10))
divide = DivideDomain²(Domain=cyl, UCount=Slider(30, range=0..100), VCount=Slider(15, range=0..100))
subsrf = Isotrim(Surface=cyl, Domain=divide)
debrep = DeconstructBrep(Brep=subsrf)  # -> Faces, Edges, Vertices
cull = CullPattern(List=debrep.Vertices, CullPattern=[False, False, True, True])
crv = Curve(debrep.Edges)
pipe = Pipe(Curve=crv, Radius=Slider(0.038, range=0..0.1), Caps=0)
sph = Sphere(Base=debrep.Vertices, Radius=Slider(0.07, range=0..0.1))
dispatch = Dispatch(List=cull, DispatchPattern=[True, False])  # -> ListA, ListB
subtraction = Subtraction(A=dispatch.ListB, B=dispatch.ListA)

# ---- group: Part A1 - Input Geolocation manually
list = ValueList({"Delhi", "Doha", "Hong Kong", "Innsbruck", "Kyoto", "London", "Los Angeles", "Miami", "Nicosia", "Seoul", "Tehran", "Tokyo", "Berlin", "Zürich": "Zurich", "Orlando"}, selected="Miami")
python_3 = GhPythonScript(apiKey="38aea6098cb9638a2062fbda470e1a79", city=list)  # -> weather
# ---------- python_3: Python ----------
from System.Net import WebClient
import json

url = "https://api.openweathermap.org/data/2.5/weather?q=" + city + "&appid=" + apiKey
response = WebClient().DownloadString(url)

#print(response)

dict = json.loads(response)

weather = dict["weather"][0]["main"]
location = dict["name"]

print(weather)
# ---------- end python_3 ----------
panel_8 = Panel(python_3)

# ----
python_4 = GhPythonScript(weather=panel_8)  # -> angle
# ---------- python_4: Python ----------
from math import pi

weather = str(weather).lower()
maxAngle = pi

if weather == "clear":
    angle = maxAngle*1.00
    
elif weather == "clouds":
    angle = maxAngle*0.75
    
elif weather == "mist":
    angle = maxAngle*0.50
    
elif weather == "drizzle":
    angle = maxAngle*0.30

elif weather == "rain":
    angle = maxAngle*0.15
    
elif weather == "haze":
    angle = 0

else:
    angle = 0

print(angle)
# ---------- end python_4 ----------
num = Number(python_4)
deg = Degrees(Radians=num)
panel_9 = Panel(deg)

# ---- group: Part D - Windows Serco Control
# In the movie of the mock-up angles
# are given manually in degrees
# (0° windows closed, 180° fully open)
number_slider = Slider(30, range=0..180)
toggle_2 = BooleanToggle(True)
ports_available_2 = COMPortsAvailable()  # -> flatten(PortNumberAvailable)
panel_10 = Panel(ports_available_2)
open_port_2 = OpenClosePort(OpenClosePort=toggle_2, PortNumber=ports_available_2, BaudRate="115200")
timer_2 = Timer(TimerInterval=100, Target=uno_write)
uno_write = UnoWrite(
    StartWritingValues=toggle_2,
    DigitalPin13=0,
    DigitalPin12=0,
    DigitalPin11=0,
    DigitalPin10=0,
    DigitalPin9=deg,
    DigitalPin8=0,
    DigitalPin6=0,
    DigitalPin5=0,
    DigitalPin3=0,
    PortNumber=panel_10)  # -> ArduinoOutput, StatusMessage
read_2 = SerialReadGeneric(StartReadingValues=toggle_2, PortNumber=ports_available_2)  # -> SerialOutput, StatusMessage
panel_11 = Panel(open_port_2)
panel_12 = Panel(read_2.StatusMessage)
panel_13 = Panel(uno_write.StatusMessage)
panel_14 = Panel(uno_write.ArduinoOutput)
codegen = CodeGenerator(Input=uno_write.ArduinoOutput)
panel_15 = Panel(codegen)

# ---- group: Windows rotation
rot3d = Rotate3D(Geometry=debrep.Faces, Angle=degrees(deg), Center=dispatch.ListA, Axis=subtraction)  # -> Geometry, Transform
